# Grasshopper definition dynamic_geometry.gh (Grasshopper 1.0.7)

# ----
# Use Aperture component to create
# static windows.
panel = Panel("custom_glass")
glassmod = HBGlassModifier(name=panel, trans="0.65")  # -> modifier; plug-in component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
brep = Brep([<brep referenced from the Rhino model> x12])
aperture = HBAperture(geo=brep, name="static_window", rad_mod=glassmod)  # -> report, apertures; plug-in component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

# ---- group: Opaque Faces
geo = Geometry([<brep referenced from the Rhino model> x23])
roomsolid = HBRoomFromSolid(geo=flatten(geo), conditioned=True)  # -> report, rooms; plug-in component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

# ---- group: Electrochromic states
glassmod_2 = HBGlassModifier(name="Tint_1", trans="0.12")  # -> modifier; plug-in component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
glassmod_3 = HBGlassModifier(name="Tint_0", trans="0.4")  # -> modifier; plug-in component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
state = HBDynamicState(modifier=glassmod_2)  # -> state; plug-in component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
state_2 = HBDynamicState(modifier=glassmod_3)  # -> state; plug-in component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
merge = Merge(Data1=state_2, Data2=state)

# ---- group: class_room
geo_2 = Geometry(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)

# ---- group: office
geo_3 = Geometry(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)

# ---- group: Context!
brep_2 = Brep(<brep referenced from the Rhino model>)
shade = HBShade(geo=brep_2)  # -> report, shades; plug-in component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

# ----
# Use Aperture component to create
# static windows.
panel_2 = Panel("custom_glass")
glassmod_4 = HBGlassModifier(name=panel_2, trans="0.65")  # -> modifier; plug-in component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
brep_3 = Brep(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)
aperture_2 = HBAperture(geo=brep_3, name="north_window", rad_mod=glassmod_4)  # -> report, apertures; plug-in component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

brep_4 = Brep(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)
aperture_3 = HBAperture(geo=brep_4, name="EC_Aperture")  # -> report, apertures; plug-in component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
aperturegroup = HBDynamicApertureGroup(apertures=aperture_3.apertures, name="Electrochromic_Windows", states=merge)  # -> group_aps; plug-in component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

# ---- group: Electrochromic states
glassmod_5 = HBGlassModifier(name="Tint_1", trans="0.12")  # -> modifier; plug-in component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
glassmod_6 = HBGlassModifier(name="Tint_0", trans="0.4")  # -> modifier; plug-in component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
state_3 = HBDynamicState(modifier=glassmod_5)  # -> state; plug-in component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
state_4 = HBDynamicState(modifier=glassmod_6)  # -> state; plug-in component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
merge_2 = Merge(Data1=state_4, Data2=state_3)

# ----
skylight_2 = Brep(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)

# ---- group: skylight_1
brep_5 = Brep(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)

# ---- group: Opaque Faces
panel_3 = Panel("""class_room
office""")
roomsolid_2 = HBRoomFromSolid(geo=flatten([geo_2, geo_3]), name=panel_3, conditioned=True)  # -> report, rooms; plug-in component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

# ---- group: Context!
brep_6 = Brep([<brep referenced from the Rhino model> x15])
shade_2 = HBShade(geo=brep_6)  # -> report, shades; plug-in component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

# ----
# Use the Dynamic Aperture Group component
# to create dynamic apertures. When using
# BSDF modifiers, all of the apertures
# in each group must point in the same
# direction.
panel_4 = Panel("EC_Aperture")
brep_7 = Brep([<brep referenced from the Rhino model> x11])
aperture_4 = HBAperture(geo=brep_7, name=panel_4)  # -> report, apertures; plug-in component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
aperturegroup_2 = HBDynamicApertureGroup(apertures=aperture_4.apertures, name="EC_ApertureGroup", states=merge_2)  # -> group_aps; plug-in component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

# ----
# Simple scene
python = GhPythonScript()  # -> a
# ---------- python: Python ----------
import os
a = os.path.dirname(ghenv.Component.OnPingDocument().FilePath) + r'\xmls\\'
# ---------- end python ----------
panel_5 = Panel(python)
panel_6 = Panel(python)
east_window_classroom = Brep(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)
east_window_office = Brep(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)
concat = Concatenate(FragmentA=panel_6, FragmentB="clear.xml")
concat_2 = Concatenate(FragmentA=panel_6, FragmentB="diffuse50.xml")
concat_3 = Concatenate(FragmentA=panel_5, FragmentB="clear.xml")
concat_4 = Concatenate(FragmentA=panel_5, FragmentB="diffuse50.xml")
bsdfmod = HBBSDFModifier(xml_file=concat_2)  # -> modifier; plug-in component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
bsdfmod_2 = HBBSDFModifier(xml_file=concat)  # -> modifier; plug-in component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
bsdfmod_3 = HBBSDFModifier(xml_file=concat_4)  # -> modifier; plug-in component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
bsdfmod_4 = HBBSDFModifier(xml_file=concat_3)  # -> modifier; plug-in component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
state_5 = HBDynamicState(modifier=bsdfmod_2)  # -> state; plug-in component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
state_6 = HBDynamicState(modifier=bsdfmod)  # -> state; plug-in component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
state_7 = HBDynamicState(modifier=bsdfmod_4)  # -> state; plug-in component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
state_8 = HBDynamicState(modifier=bsdfmod_3)  # -> state; plug-in component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
merge_3 = Merge(Data1=state_5, Data2=state_6)
merge_4 = Merge(Data1=state_7, Data2=state_8)
pt = ConstructPoint(XCoordinate="5", YCoordinate=0, ZCoordinate=0)
legendpar = LBLegendParameters(base_plane=pt, seg_height="2")  # -> leg_par; plug-in component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
roomattr = HBRoomAttributes({"Display Name": "display_name", "Simulation Name (Identifier)": "identifier", "Multiplier": "multiplier", "Story": "story", "Volume": "volume", "Gross Floor Area": "floor_area", "Exposed Area": "exposed_area", "Exterior Wall Area": "exterior_wall_area", "Exterior Aperture Area": "exterior_aperture_area", "Average Floor Elevation": "average_floor_height"}, selected="Display Name")

panel_7 = Panel("""skylight_1
skylight_2""")
aperture_5 = HBAperture(geo=[brep_5, skylight_2], name=panel_7)  # -> report, apertures; plug-in component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
aperturegroup_3 = HBDynamicApertureGroup(apertures=simplify(graft(aperture_5.apertures)), name=simplify(graft(panel_7)), states=merge_3)  # -> flatten(group_aps); plug-in component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

panel_8 = Panel("""east_window_classroom
east_window_office""")
aperture_6 = HBAperture(geo=[east_window_classroom, east_window_office], name=panel_8)  # -> report, apertures; plug-in component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
aperturegroup_4 = HBDynamicApertureGroup(apertures=simplify(graft(aperture_6.apertures)), name=simplify(graft(panel_8)), states=merge_4)  # -> flatten(group_aps); plug-in component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

addsubface = HBAddSubface(
    hb_obj=flatten(roomsolid_2.rooms),
    sub_faces=flatten([aperture_2.apertures, aperturegroup, aperturegroup_3, aperturegroup_4]))  # -> hb_obj; plug-in component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
bordershades = HBExtrudedBorderShades(hb_objs=flatten(addsubface), depth="0.3")  # -> report, hb_objs; plug-in component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

# ----
# Complex scene
python_2 = GhPythonScript()  # -> a; same code as python
panel_9 = Panel(python_2)
concat_5 = Concatenate(FragmentA=panel_9, FragmentB="clear.xml")
concat_6 = Concatenate(FragmentA=panel_9, FragmentB="diffuse50.xml")
bsdfmod_5 = HBBSDFModifier(xml_file=concat_6)  # -> modifier; plug-in component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
bsdfmod_6 = HBBSDFModifier(xml_file=concat_5)  # -> modifier; plug-in component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
state_9 = HBDynamicState(modifier=bsdfmod_6)  # -> state; plug-in component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
state_10 = HBDynamicState(modifier=bsdfmod_5)  # -> state; plug-in component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
merge_5 = Merge(Data1=state_9, Data2=state_10)
pt_2 = ConstructPoint(XCoordinate="5", YCoordinate=0, ZCoordinate=0)
legendpar_2 = LBLegendParameters(base_plane=pt_2, seg_height="2")  # -> leg_par; plug-in component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
roomattr_2 = HBRoomAttributes({"Display Name": "display_name", "Simulation Name (Identifier)": "identifier", "Multiplier": "multiplier", "Story": "story", "Volume": "volume", "Gross Floor Area": "floor_area", "Exposed Area": "exposed_area", "Exterior Wall Area": "exterior_wall_area", "Exterior Aperture Area": "exterior_aperture_area", "Average Floor Elevation": "average_floor_height"}, selected="Display Name")

brep_8 = Brep([<brep referenced from the Rhino model> x52])
aperture_7 = HBAperture(geo=brep_8, name="aperture")  # -> report, apertures; plug-in component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

python_3 = GhPythonScript(aperture=aperture_7.apertures)  # -> name
# ---------- python_3: Python ----------
name = aperture.display_name
# ---------- end python_3 ----------

aperturegroup_5 = HBDynamicApertureGroup(apertures=simplify(graft(aperture_7.apertures)), name=simplify(graft(python_3)), states=merge_5)  # -> flatten(group_aps); plug-in component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

addsubface_2 = HBAddSubface(hb_obj=flatten(roomsolid.rooms), sub_faces=flatten([aperture.apertures, aperturegroup_5, aperturegroup_2]))  # -> hb_obj; plug-in component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
bordershades_2 = HBExtrudedBorderShades(hb_objs=flatten(addsubface_2), depth="0.3")  # -> report, hb_objs; plug-in component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

gridrooms = HBSensorGridFromRooms(rooms=addsubface_2, grid_size="1.0", dist_floor="0.8")  # -> grid, points, mesh; plug-in component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

# ----
# Model
panel_10 = Panel("three-phase-test")
model = HBModel(rooms=flatten(bordershades_2.hb_objs), shades=flatten(shade_2.shades), name=panel_10)  # -> report, model; plug-in component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
assigngridsviews = HBAssignGridsAndViews(model=model.model, grids=flatten(gridrooms.grid))  # -> model; plug-in component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

# ----
# Visualize Model
faceradianceattr = HBFaceEnergyAttributes({"Modifier": "properties.radiance.modifier.display_name", "Modifier Blk": "properties.radiance.modifier_blk.display_name", "Is Opaque": "properties.radiance.is_opaque", "Dynamic Group": "properties.radiance.dynamic_group_identifier", "State Count": "properties.radiance.state_count", "States": "properties.radiance.states"}, selected="Dynamic Group")
colorfaceattr = HBColorFaceAttributes(hb_objs=flatten(assigngridsviews), attribute=faceradianceattr, legend_par=legendpar_2)  # -> mesh, legend, wire_frame, values, colors; plug-in component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

colorroomattr = HBColorRoomAttributes(rooms_model=flatten(assigngridsviews), attribute=roomattr_2)  # -> mesh, legend, wire_frame, values, colors; plug-in component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
vizwiref = HBVizualizeWireframe(hb_objs=flatten(assigngridsviews))  # -> geo; plug-in component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

# ----
# Write
# Radiance
# Model Folder
modeltorad = HBModelToRadFolder(model=assigngridsviews, write=Toggle(False))  # -> report, folder; plug-in component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
opendir = LBOpenDirectory(file_path=modeltorad.folder)  # -> report; plug-in component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

gridrooms_2 = HBSensorGridFromRooms(rooms=addsubface, grid_size="1.0", dist_floor="0.8")  # -> grid, points, mesh; plug-in component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

# ----
# Model
panel_11 = Panel("three-phase-test")
model_2 = HBModel(rooms=flatten(bordershades.hb_objs), shades=flatten(shade.shades), name=panel_11)  # -> report, model; plug-in component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
assigngridsviews_2 = HBAssignGridsAndViews(model=model_2.model, grids=flatten(gridrooms_2.grid))  # -> model; plug-in component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

# ----
# Visualize Model
faceradianceattr_2 = HBFaceEnergyAttributes({"Modifier": "properties.radiance.modifier.display_name", "Modifier Blk": "properties.radiance.modifier_blk.display_name", "Is Opaque": "properties.radiance.is_opaque", "Dynamic Group": "properties.radiance.dynamic_group_identifier", "State Count": "properties.radiance.state_count", "States": "properties.radiance.states"}, selected="Dynamic Group")
colorfaceattr_2 = HBColorFaceAttributes(hb_objs=flatten(assigngridsviews_2), attribute=faceradianceattr_2, legend_par=legendpar)  # -> mesh, legend, wire_frame, values, colors; plug-in component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

colorroomattr_2 = HBColorRoomAttributes(rooms_model=flatten(assigngridsviews_2), attribute=roomattr)  # -> mesh, legend, wire_frame, values, colors; plug-in component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
vizwiref_2 = HBVizualizeWireframe(hb_objs=flatten(assigngridsviews_2))  # -> geo; plug-in component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

# ----
# Write
# Radiance
# Model Folder
modeltorad_2 = HBModelToRadFolder(model=assigngridsviews_2, write=Toggle(False))  # -> report, folder; plug-in component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
opendir_2 = LBOpenDirectory(file_path=modeltorad_2.folder)  # -> report; plug-in component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
